# Grasshopper definition Tag Generator.gh (Grasshopper 1.0.8)

# ---- group: User Input
text_size = Slider(13, range=0..15)
panel = Panel("Bean")

# ----
tag_head_height = Number(15)
tag_head_width = Number(31.75)
neg = Negative(Value=tag_head_height)
neg_2 = Negative(Value=tag_head_width)
y_domain = ConstructDomain(DomainStart=neg, DomainEnd=tag_head_height)
x_domain = ConstructDomain(DomainStart=neg_2, DomainEnd=tag_head_width)

# ---- group: Tag Stem Size
number = Number(12.5)
number_2 = Number(-15)
_0 = Number(0)
number_3 = Number(-78)

# ----
neg_3 = Negative(Value=number)
pt = ConstructPoint(XCoordinate=neg_3, YCoordinate=number_2, ZCoordinate=0)
pt_2 = ConstructPoint(XCoordinate=number, YCoordinate=number_2, ZCoordinate=0)
pt_3 = ConstructPoint(XCoordinate=_0, YCoordinate=number_3, ZCoordinate=0)
merge = Merge(Data1=pt, Data2=pt_2, Data3=pt_3)
true = Boolean(True)
tag_spike = PolyLine(Vertices=merge, Closed=true)
tag_head = Rectangle(Plane=PlaneXY(0, 0, 0), XSize=x_domain, YSize=y_domain, Radius=0)  # -> Rectangle, Length
text_configuration = AnnotationTextSettings(TextHeight=text_size, HorizontalAlignment=1, VerticalAlignment=3)
_0_2 = Number(0)
_3 = Number(1.5)
runion = RegionUnion(Curves=[tag_head.Rectangle, tag_spike])
fillet_size = Number(3)
text_center_point = ConstructPoint(XCoordinate=_0_2, YCoordinate=_0_2, ZCoordinate=_3)
annotation_style = AnnotationStyle(Name="Default", TextSettings=text_configuration)
number_4 = Number(1.5)
corner_rounding = Fillet(Curve=runion, Radius=fillet_size)
number_5 = Number(-0.9)
_0_3 = Number(0.001)
number_6 = Number(-3)
text = TextEntity(Plane=text_center_point, Text=panel, Style=annotation_style)  # -> TextEntity, Plane, Text, Style
neg_4 = Negative(Value=number_4)
_3_2 = Number(1.5)
boundary = BoundarySurfaces(Edges=corner_rounding)
Z = UnitZ(Factor=neg_4)
tag_center_coords = ConstructPoint(XCoordinate=_0_3, YCoordinate=number_6, ZCoordinate=number_5)
Z_2 = UnitZ(Factor=number_4)
Z_3 = UnitZ(Factor=_3_2)
tag_radius = Number(13)
tag_depth = Number(1.5)
explode = ExplodeObject(Object=text.TextEntity, Recursive=False)
tag_cavity_extrusion = Extrude(Base=boundary, Direction=Z)
tag_cavity_extrusion_2 = Extrude(Base=boundary, Direction=Z_2)
boundary_2 = BoundarySurfaces(Edges=explode)
cyl = Cylinder(Base=tag_center_coords, Radius=tag_radius, Length=tag_depth)
extr = Extrude(Base=boundary_2, Direction=Z_3)
shell_to_solid_cap = CapHoles(Brep=[tag_cavity_extrusion, tag_cavity_extrusion_2])
shell_to_solid_cap_2 = CapHoles(Brep=cyl)
cap = CapHoles(Brep=extr)
sdiff = SolidDifference(BrepsA=shell_to_solid_cap, BrepsB=shell_to_solid_cap_2)
grp = Group([cap, sdiff])
